# Grasshopper definition Millipede_typologyoptimization_shell&box.gh (Grasshopper 1.0.7)
# plug-ins: Millipede

line = Line(Line((0, 0, 0), (0, 16, 5)))
line_2 = Line(Line((0, 0, 0), (15, 0, 5)))
line_3 = Line(Line((15, 0, 5), (17, 18, 0)))
line_4 = Line(Line((17, 18, 0), (0, 16, 5)))
number_slider = Slider(20, range=0..100)
edge_surface = EdgeSurface(CurveA=line, CurveB=line_2, CurveC=line_3, CurveD=line_4)

# ----
# 3D box optimization
number_slider_2 = Slider(4, range=0..10)
number_slider_3 = Slider(17, range=0..100)
unit_z = UnitZ(Factor=Slider(194, range=0..1000))
center_box = CenterBox(Base=PlaneXY(-40, 56, 0), X=Slider(24, range=0..100), Y=number_slider_2, Z=number_slider_3)
unit_z_2 = UnitZ(Factor=number_slider_3)
negative = Negative(Value=unit_z)
brep = Brep(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)
brep_2 = Brep([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])
support_type = SupportType(X=True, Y=True, Z=True, RX=True, RY=True, RZ=True)
move = Move(Geometry=center_box, Motion=unit_z_2)  # -> Geometry, Transform
_3d_load_region = _3DLoadRegion(Boundary=brep, Load=negative)
_3d_support_region = _3DSupportRegion(Boundary=brep_2, SupportType=support_type, AmendExistingSupports=True)
brep_3 = Brep(move.Geometry)
_3d_boundary_region = _3DBoundaryRegion(Boundary=brep_3, IsVoid=Toggle(True))
topostruct_3d_model = Topostruct3DModel(ModelComponents=[_3d_boundary_region, _3d_load_region, _3d_support_region], XResolution=Slider(19, range=0..100))  # -> FEModel, CellCentres, CellSize
topostruct_3d_solver = Topostruct3DSolver(
    FEModel=topostruct_3d_model.FEModel,
    SelfWeightCoefficient=0,
    OptimisationIterations=Slider(9, range=0..10),
    Smoothing=0.1,
    Penalization=3,
    TargetDensity=Slider(0.17, range=0..1),
    MinimumDensity=0.001,
    DeleteThreshold=0.5,
    PeriodicX=False,
    PeriodicY=False,
    PeriodicZ=False,
    LoadCase=0,
    AllCases=True)  # -> FEModel, MaxDeflection
_3d_iso_mesh = _3DIsoMesh(FEModel=topostruct_3d_solver.FEModel, Deflection=0, IsoContourValue=Slider(0.1339, range=0..1), ColorMode=3)

mesh_surface = MeshSurface(Surface=edge_surface, UCount=number_slider, VCount=number_slider, Overhang=True, Equalize=False)

# ----
# support
support_type_2 = SupportType(X=True, Y=True, Z=True, RX=True, RY=True, RZ=True)
point = Point(Point(17, 18, 0))
point_2 = Point(Point(0, 0, 0))
fe_point_supports = FEPointSupports(Point=[point, point_2], SupportType=support_type_2)

# ----
# mesh
number_slider_4 = Slider(0.027, range=0..1)
material = Material(MaterialType=2)
fe_mesh = FEMesh(Meshes=mesh_surface, Material=material, Thickness=number_slider_4, AreaLoad=Vector(0, 0, 0), NormalAreaLoad=0)

point_3 = Point(Point(0, 16, 5))

# ----
# load
number_slider_5 = Slider(10000, range=0..10000)
negative_2 = Negative(Value=number_slider_5)
unit_z_3 = UnitZ(Factor=negative_2)
point_4 = Point(Point(15, 0, 5))
fe_point_load = FEPointLoad(Point=[point_4, point_3], Load=unit_z_3)

fea_system = FEASystem(
    ModelComponents=flatten([fe_point_load, fe_point_supports, fe_mesh]),
    IntersectAddedCurves=True,
    MergeTolerance=0.0001,
    MinimumCurveSpan=0.05,
    MaximumCurveSpan=10000,
    CurveTolerance=0.1)
fe_solver = FESolver(
    FEModel=fea_system,
    SelfWeightCoefficient=1,
    BeamOptimisationIterations=0,
    QuadOptimisationIterations=0,
    OptimizationTarget=0.3,
    OptimizationPenalization=2,
    LoadCase=0,
    AllCases=True)  # -> FEModel, MaxDeflection, Weight

# ----
# stress lines
populate_geometry = PopulateGeometry(Geometry=mesh_surface, Count=100, Seed=1)
stress_lines = StressLines(FEModel=fe_solver.FEModel, Points=populate_geometry, Plane=1)  # -> Stress1, Stress2
custom_preview = CustomPreview(Geometry=stress_lines.Stress1, Material=ColourSwatch(SwatchColor=RGB(224, 80, 255)))
custom_preview_2 = CustomPreview(Geometry=stress_lines.Stress2, Material=ColourSwatch(SwatchColor=RGB(109, 140, 255)))

panel = Panel(fe_solver.MaxDeflection)
mesh_visualization = MeshVisualization(FEModel=fe_solver.FEModel, Deflection=0, Plane=1, ShowThickness=Toggle(True), ColorMode=2)  # -> Mesh, CompleteRange, VisibleRange
